# Grasshopper definition cornerclip.gh (Grasshopper 1.0.7)

slot_width = Slider(5.3, range=4.3..5.7)
clip_radius = Slider(25, range=15..28)
slot_depth = Slider(18, range=15..22)
slot_distance = Slider(9.439, range=5..15)
division = Division(A=slot_width, B=-2)
circle = Circle(Plane=PlaneXY(0, 0, 0), Radius=clip_radius)
rectangle = Rectangle(Plane=PlaneXY(0, 0, 0), XSize=slot_depth, YSize=slot_width, Radius=0)  # -> Rectangle, Length
side_length = Slider(35, range=10..35)
Y = Slider(-4.464, range=-15..15)
X = Slider(-4.498, range=-15..15)
vector_xyz = VectorXYZ(XComponent=slot_distance, YComponent=division, ZComponent=0)  # -> Vector, Length
move = Move(Geometry=rectangle.Rectangle, Motion=vector_xyz.Vector)  # -> Geometry, Transform
number_of_slots = Slider(8, range=4..8)
vector_xyz_2 = VectorXYZ(XComponent=X, YComponent=Y, ZComponent=0)  # -> Vector, Length
square = Square(Plane=PlaneXY(0, 0, 0), Size=side_length, ExtentX=1, ExtentY=1)  # -> Cells, Points
move_2 = Move(Geometry=square.Cells, Motion=vector_xyz_2.Vector)  # -> Geometry, Transform
polar_array = PolarArray(Geometry=move.Geometry, Plane=PlaneXY(0, 0, 0), Count=number_of_slots, Angle=6.283185307)  # -> Geometry, Transform
group = Group(Objects=[move_2.Geometry, circle, polar_array.Geometry])
