# Grasshopper definition nestedOctogons.gh (Grasshopper 1.0.7)

number_of_sides = Slider(8, range=4..10)
radius = Slider(40, range=25..50)
polygon = Polygon(Plane=PlaneXY(0, 0, 0), Radius=radius, Segments=number_of_sides, FilletRadius=0)  # -> Polygon, Length
offset_curve = OffsetCurve(Curve=polygon.Polygon, Distance=Slider(-4, range=-10..10), Plane=PlaneXY(0, 0, 0), Corners=1)
offset_curve_2 = OffsetCurve(Curve=offset_curve, Distance=Slider(-4, range=-10..10), Plane=PlaneXY(0, 0, 0), Corners=1)
offset_curve_3 = OffsetCurve(Curve=offset_curve_2, Distance=Slider(-4, range=-10..10), Plane=PlaneXY(0, 0, 0), Corners=1)
offset_curve_4 = OffsetCurve(Curve=offset_curve_3, Distance=Slider(-4, range=-10..10), Plane=PlaneXY(0, 0, 0), Corners=1)
offset_curve_5 = OffsetCurve(Curve=offset_curve_4, Distance=Slider(-4, range=-10..10), Plane=PlaneXY(0, 0, 0), Corners=1)
offset_curve_6 = OffsetCurve(Curve=offset_curve_5, Distance=Slider(-4, range=-10..10), Plane=PlaneXY(0, 0, 0), Corners=1)
offset_curve_7 = OffsetCurve(Curve=offset_curve_6, Distance=Slider(-4, range=-10..10), Plane=PlaneXY(0, 0, 0), Corners=1)
group = Group(Objects=[offset_curve_7, offset_curve_6, offset_curve_5, offset_curve_4, offset_curve_3, offset_curve_2, offset_curve, polygon.Polygon])
