# Grasshopper definition lampInner_autosave.gh (Grasshopper 1.0.7)

# Inner Diameter Range
# 27.5mm - 28.1mm
smaller_radius = Slider(14, range=13.75..14.05)
# Larger Diameter Range
# 37.3mm - 38mm
larger_radius = Slider(18.85, range=18.6..18.85)
offset = Slider(2, range=1.5..5)
offset_2 = Slider(2, range=1.5..5)
circle = Circle(Plane=PlaneXY(0, 0, 0), Radius=smaller_radius)
circle_2 = Circle(Plane=PlaneXY(0, 0, 0), Radius=larger_radius)
offset_curve = OffsetCurve(Curve=circle, Distance=offset, Plane=PlaneXY(0, 0, 0), Corners=1)
offset_curve_2 = OffsetCurve(Curve=circle_2, Distance=offset_2, Plane=PlaneXY(0, 0, 0), Corners=1)
group = Group([offset_curve, offset_curve_2, circle_2, circle])
