# Grasshopper definition bowlingGame.gh (Grasshopper 1.0.7)

storage_box_width = Slider(100, range=90..100)
storage_length = Slider(150, range=125..150)
length_subtraction = Slider(10, range=8..10)
width_subtraction = Slider(4, range=3..5)
# Box Reference:
# Outer Wall: 5mm
subtraction = Subtraction(A=storage_length, B=5)
storage_height = Slider(50, range=40..60)
# Storage box size.
# (Only for reference)
rectangle = Rectangle(Plane=PlaneXY(0, 0, 0), XSize=storage_length, YSize=storage_box_width, Radius=0)  # -> Rectangle, Length
division = Division(A=storage_box_width, _1=-1)
# 1. Extrude this rectangle
# to a height of 50mm.
rectangle_2 = Rectangle(Plane=PlaneXY(0, 0, 0), XSize=subtraction, YSize=storage_box_width, Radius=0)  # -> Rectangle, Length
subtraction_2 = Subtraction(A=storage_box_width, B=width_subtraction)
subtraction_3 = Subtraction(A=storage_length, B=length_subtraction)
subtraction_4 = Subtraction(A=division, _25=25)
# 3. Rectangle cutout section, make
# into surface and move up 5mm.
# Moved surface up 5mm for
# the bottom surface.
offset_curve = OffsetCurve(Curve=rectangle.Rectangle, Distance5=-5, Plane=PlaneXY(0, 0, 0), Corners=1)
# <--This is for the cutout extrusion.
subtraction_5 = Subtraction(A=storage_height, B=5)
vector_xyz = VectorXYZ(XComponent=0, YComponent=0, ZComponent=storage_height)  # -> Vector, Length
rectangle_3 = Rectangle(Plane=PlaneXY(0, 0, 0), XSize=subtraction_3, YSize=subtraction_2, Radius=0)  # -> Rectangle, Length
# Box
surface = Surface(rectangle_2.Rectangle)
division_2 = Division(A=width_subtraction, B=2)
division_3 = Division(A=length_subtraction, B=2)
vector_xyz_2 = VectorXYZ(XComponent=0, YComponent=0, ZComponent5=5)  # -> Vector, Length
# Shift top lid (2nd have of bowling
# alley) to the side.
vector_xyz_3 = VectorXYZ(XComponent5=5, YComponent=subtraction_4, ZComponent=0)  # -> Vector, Length
subtraction_6 = Subtraction(A=subtraction_3, B=5)
surface_2 = Surface(offset_curve)
# 2. Bake this extrusion!
extrude = Extrude(Base=surface, Direction=vector_xyz.Vector)
subtraction_7 = Subtraction(A=storage_box_width, _10=10)
# Sliding Lid
subtraction_8 = Subtraction(A=subtraction_3, B=5)
# Lid's Bottom reference.
move = Move(Geometry=rectangle_3.Rectangle, Motion=vector_xyz_3.Vector)  # -> Geometry, Transform
rectangle_4 = Rectangle(Plane=PlaneXY(0, 0, 0), XSize=subtraction_6, YSize=subtraction_2, Radius=0)  # -> Rectangle, Length
move_2 = Move(Geometry=surface_2, Motion=vector_xyz_2.Vector)  # -> Geometry, Transform
vector_xyz_4 = VectorXYZ(XComponent=0, YComponent=0, ZComponent=subtraction_5)  # -> Vector, Length
vector_xyz_5 = VectorXYZ(XComponent10=10, YComponent=subtraction_4, ZComponent=0)  # -> Vector, Length
vector_xyz_6 = VectorXYZ(XComponent10=10, YComponent122=-122, ZComponent5=5)  # -> Vector, Length
rectangle_5 = Rectangle(Plane=PlaneXY(0, 0, 0), XSize=subtraction_8, YSize=subtraction_7, Radius=0)  # -> Rectangle, Length
vector_xyz_7 = VectorXYZ(XComponent=division_3, YComponent=division_2, ZComponent=0)  # -> Vector, Length
# 4. Bake this extrusion and BooleanDifference
# from the box extrusion created in #2.
extrude_2 = Extrude(Base=move_2.Geometry, Direction=vector_xyz_4.Vector)
move_3 = Move(Geometry=rectangle_5.Rectangle, Motion=vector_xyz_6.Vector)  # -> Geometry, Transform
move_4 = Move(Geometry=rectangle_4.Rectangle, Motion=vector_xyz_5.Vector)  # -> Geometry, Transform
# Slide in Reference
move_5 = Move(Geometry=rectangle_3.Rectangle, Motion=vector_xyz_7.Vector)  # -> Geometry, Transform
# Bottom Loft
surface_3 = Surface(move_4.Geometry)
# Top Loft
surface_4 = Surface(move_3.Geometry)
# Bake this loft, flip it,
# and then cap it.
# After capping, move and align the lid with
# the box (the side with the cut wall), and
# BooleanDifference with the box. Move the
# sliding lid to the back wall of the box,
# and BooleanDifference again.
# Then, cut 1mm from the diagonal sides of the lid.
# This will allow the sliding lid to slide back and forth easily.
loft = Loft(
    Curves=[surface_3, surface_4],
    Options={Adjust=False, Closed=False, LoftEnds=0, LoftSimp=0, LoftType=0, Rebuild=10, Refit=0.01})
# Storage Box Reference:
# Outer Wall: 3mm
# Inner Walls to separate items: 2mm
# 
# Offsets:
# 1. DupEdge the edge for the lid and join,
# 2. Create a curve offset 3mm from the edge
# on the inside,
# 3. Create another curve offset from the last
# curve (0.2mm-.75mm on the inside).
# 4. Move the curve created in step 3 up 3mm.
# 5. Loft and cap the curves from steps 2 and 4.
# 6. BooleanUnion lid.
# Storage Box
# The silicone mold produces rectangular bowling pins that are 10mm x 10mm x 50mm.
# This small storage box holds can hold one set of bowling blocks or pins and 2 large bowling balls.
x_size = Slider(98, range=98..99)
y_size = Slider(71, range=71..72)
# Large Storage Box
# This large storage box can hold both sets of bowling pins, 1 set of bowling blocks, and 2 bowling balls.
x_size_2 = Slider(130, range=98..130)
y_size_2 = Slider(85, range=71..85)
rectangle_6 = Rectangle(Plane=PlaneXY(0, 0, 0), XSize=x_size, YSize=y_size, Radius=0)  # -> Rectangle, Length
rectangle_7 = Rectangle(Plane=PlaneXY(0, 0, 0), XSize=x_size, YSize=y_size, Radius=0)  # -> Rectangle, Length
rectangle_8 = Rectangle(Plane=PlaneXY(0, 0, 0), XSize=x_size_2, YSize=y_size_2, Radius=0)  # -> Rectangle, Length
rectangle_9 = Rectangle(Plane=PlaneXY(0, 0, 0), XSize=x_size_2, YSize=y_size_2, Radius=0)  # -> Rectangle, Length
vector_xyz_8 = VectorXYZ(XComponent=0, YComponent=0, ZComponent35=35)  # -> Vector, Length
vector_xyz_9 = VectorXYZ(XComponent=0, YComponent=0, ZComponent35=35)  # -> Vector, Length
vector_xyz_10 = VectorXYZ(XComponent=0, YComponent=0, ZComponent6=6)  # -> Vector, Length
# The lid should be 6mm thick
# after lofting the internal section.
vector_xyz_11 = VectorXYZ(XComponent=0, YComponent=0, ZComponent3=3)  # -> Vector, Length
surface_5 = Surface(rectangle_7.Rectangle)
surface_6 = Surface(rectangle_6.Rectangle)
surface_7 = Surface(rectangle_9.Rectangle)
surface_8 = Surface(rectangle_8.Rectangle)
# Bake this.
extrude_3 = Extrude(Base=surface_5, Direction=vector_xyz_8.Vector)
# Bake this.
extrude_4 = Extrude(Base=surface_6, Direction=vector_xyz_10.Vector)
# Bake this.
extrude_5 = Extrude(Base=surface_7, Direction=vector_xyz_9.Vector)
# Bake this.
extrude_6 = Extrude(Base=surface_8, Direction=vector_xyz_11.Vector)
vector_xyz_12 = VectorXYZ(XComponent=5, YComponent=5, ZComponent=5)  # -> Vector, Length
move_6 = Move(Geometry=[extrude_5, extrude_6], Motion=vector_xyz_12.Vector)  # -> Geometry, Transform
